% Simulink data dictionary EvVCU.sldd

CtrlVcuEvDischrgLmtBpt = [0 0.35 0.7 1 1 1 1 1 1 1 1]
CtrlVcuEvChrgLmtBpt = [1 1 1 1 1 1 1 1 0.7 0.35 0]
CtrlVcuEvBattDischrgPwrMax = 211000
CtrlVcuEvBattChrgPwrMax = -211000
CtrlVcuEvSocBpt = [0 10 20 30 40 50 60 70 80 90 100]
CtrlVcuEvRegenBrkCutOff = [0 1]
CtrlVcuEvRegenBrkSpdBpt = [5 9]
RegenSprtStrt = 2.5
RegenStrt = 5
RegenEnd = 9
EnvGrvty = 9.81

BattCurLims = Simulink.Bus(HeaderFile="impl_type_battcurlims.h")
  DischargeCurrentLimit: single, Unit="A"
  ChargeCurrentLimit: single, Unit="A"