% Simulink data dictionary EvVCU_ModelSpecific.sldd

CtrlVcuAccelPdlBpts = [0 0.8 1]
CtrlVcuBattPnlty = 10000000
CtrlVcuBattSOCBpts = [0 20 60 80 100]
CtrlVcuCnstrntPnltyFctr = 10000000
CtrlVcuEMPnlty = 100
CtrlVcuEMTrqSplitGrid = 200
CtrlVcuFallRate = -500
CtrlVcuMaxAccelG = 1
CtrlVcuMaxDecelG = -1.5
CtrlVcuPwrDeltaPnlty = 50
CtrlVcuPwrRatePnlty = [25 25 100]
CtrlVcuRiseRate = 500
CtrlVcuRoadMuEst = 0.8
CtrlVcuSftyFctr = 0.9
CtrlVcuTracPwrErrPnlty = 25
CtrlVcuTrqVecBrkThresh = 0.01
CtrlVcuTrqVecIGain = 0
CtrlVcuTrqVecMinTrq = 25
CtrlVcuTrqVecPGain = -2000
CtrlVcuTrqVecSteerThresh = 0.3490659
CtrlVcuTrqVecVelThresh = 2.5
N_P0 = 3
Drv_Mode = int8(1)