% Simulink data dictionary VirtualVehicleTemplate.sldd
% references BatteryDCDC.sldd
% references ElectricMachine1.sldd
% references ElectricMachine2.sldd
% references Drivetrain.sldd
% references VehicleConfig.sldd
% references EvVCU.sldd
% references PassVeh.sldd
% references EvVCU_ModelSpecific.sldd
% references BMS_Software_DD.sldd

ScnFHSteerAmp = 540
PlntSpKCRollCamber = [0 0]
PlntSpKCRollCaster = [0 0]
PlntSpKCRollSteer = [0 0]
PlntSpKCRollStiffArbFrnt = 0
PlntSpKCRollStiffNoArbFrnt = 0
PlntSpKCRollStiffNoTwstRear = 0
VisScopeType = 1
VisXYPlotter = 1
PlntSpKCVrtLdTrnsfr = [0 0 0 0]
CtrlBcuTrlrBrkGain = Simulink.Parameter(0)
PlntEM1TrqLossTbl = repmat(0, 14, 11)